# Grasshopper definition 220325 modify mullion profile.gh (Grasshopper 1.0.7)
# plug-ins: ggRhinoIFC

file_path = FilePath("B:\Git\ByElementIFC_Data\GG Edit Script\AR_IfcWall_1fIVuvFffDJRV_SJESOtFR_0c1ba2ba-c7d5-4a2e-99d3-28ae56e83e49.Ifc")
ggifc_readfile = GgIFCReadFile(FilePath=file_path, Transform=True, Filters="IfcProfileDef")  # -> Project, Filtered
panel = Panel(ggifc_readfile.Filtered)
ggifc_decompose_profiledef = GgIFCDecomposeProfileDef(IFCProfileDef=ggifc_readfile.Filtered)  # -> Name, AreaOrCurveProfile, Profile
match_text = MatchText(Text=ggifc_decompose_profiledef.Name, Pattern="50 x 150mm", Case=True)
dispatch = Dispatch(List=ggifc_readfile.Filtered, DispatchPattern=match_text)  # -> ListA, ListB
c_script = CSharpScript(
    x=dispatch.ListA,
    Reference="C:\Users\greg.schleusner\AppData\Roaming\McNeel\Rhinoceros\packages\7.0\ggRhinoIFC\2.2.6.0\ggIFC.gha")  # -> out, A; inputs x: list
# ---------- c_script: C# usings ----------
using GeometryGym.Ifc;
using System.Linq;
# ---------- c_script: C# ----------
    List<Tuple<double, double>> points = new  List<Tuple<double, double>>();
    points.Add(new Tuple<Double,double>(-150, -200));
    points.Add(new Tuple<Double,double>(150, -200));
    points.Add(new Tuple<Double,double>(150, 200));
    points.Add(new Tuple<Double,double>(-150, 200));
    points.Add(new Tuple<Double,double>(-150, -200));
    List<IfcArbitraryClosedProfileDef> profiles = x.OfType<IfcArbitraryClosedProfileDef>().ToList();
    var pointList = new IfcCartesianPointList2D(profiles.First().Database, points);
    foreach(IfcArbitraryClosedProfileDef profile in profiles)
    {
      IfcIndexedPolyCurve outer = profile.OuterCurve as IfcIndexedPolyCurve;
      outer.Points = pointList;
      profile.Name = "50 x 300mm";
    }
    A = pointList;
# ---------- end c_script ----------
list_length = ListLength(List=c_script.A)
file_path_2 = FilePath("B:\Git\ByElementIFC_Data\GG Edit Script\AR_IfcWall_1fIVuvFffDJRV_SJESOtFR_mod_2.Ifc")
ggifc_stream_bake = GgIFCStreamBake(Path=file_path_2, Enabled=list_length, IfcProject=ggifc_readfile.Project)
